# Grasshopper definition 210421_Parametric Joint.gh (Grasshopper 1.0.7)

show_contact_srf = BooleanToggle(True)
# Preview
show_joint_srf = BooleanToggle(True)

# ---- group: Parameters -y- A
y2 = Slider(0.129, range=0..1)
y1 = Slider(0.252, range=0..1)
eval = Evaluate(F="if(y<(1-x),\"OK\",\"ERROR\")", x=y1, y=y2)
check_geometry = Panel(eval)
merge = Merge(Data1=y1, Data2=y2)

# ---- group: Parameters -y- B
y4 = Slider(0.18, range=0..1)
y3 = Slider(0.184, range=0..1)
eval_2 = Evaluate(F="if(y<(1-x),\"OK\",\"ERROR\")", x=y3, y=y4)
check_geometry_2 = Panel(eval_2)
merge_2 = Merge(Data1=y3, Data2=y4)

# ---- group: Main Geometry
# Beam 2
w2_mm = Slider(100, range=0..200)

# ---- group: Parameters -z-
z1 = Slider(0.5, range=0..1)
z2 = Slider(0.51, range=0..1)

# ---- group: Parameters -x- B
list = ValueList({"Type 1(+)": 1, "Type 2(+)": 2}, selected="Type 2(+)")
x4 = Slider(0.042, range=-0.3..0.3)
panel = Panel("""Type 1: Flat
Type 2: Sharp""")
x3 = Slider(0.107, range=0..1)
merge_3 = Merge(Data1=x3, Data2=x4, Data3=list)
eval_3 = Evaluate(F="if(x+y<0,\"ERROR\",\"OK\")", x=x3, y=x4)
check_geometry_3 = Panel(eval_3)

# ---- group: Parameters -x- A
list_2 = ValueList({"Type 1(+)": 1, "Type 2(+)": 2}, selected="Type 2(+)")
x2 = Slider(0.12, range=-0.3..0.3)
x1 = Slider(0.048, range=0..1)
merge_4 = Merge(Data1=x1, Data2=x2, Data3=list_2)
eval_4 = Evaluate(F="if(x+y<0,\"ERROR\",\"OK\")", x=x1, y=x2)
check_geometry_4 = Panel(eval_4)

# ---- group: Main Geometry
# Geometric parameters
# Beam 1 (+)
w1_mm = Slider(100, range=0..200)
h1_mm = Slider(100, range=0..200)
merge_5 = Merge(Data1=w1_mm, Data2=h1_mm)

# ---- group: Inputs (+)
merge_6 = Merge(Data1=merge_5, Data2=merge_4, Data3=merge, Data4=z1, Data5=w2_mm)

# ---- group: Inputs (-)
merge_7 = Merge(Data1=merge_5, Data2=merge_3, Data3=merge_2, Data4=z1, Data5=w2_mm)

# ----
item = ListItem(List=merge_6, Index=0, Wrap=True)  # -> Item, Item1, Item2, Item3, Item4, Item5, Item6, Item7, Item8
item_2 = ListItem(List=merge_7, Index=0, Wrap=True)  # -> Item, Item1, Item2, Item3, Item4, Item5, Item6, Item7, Item8
x1_2 = Number(item.Item2)
x2_2 = Number(item.Item3)
w2 = Number(item.Item8)
type = Number(item.Item4)
y2_2 = Number(item.Item6)
z1_2 = Number(item.Item7)
w1 = Number(item.Item)
h1 = Number(item.Item1)
y1_2 = Number(item.Item5)
x1_3 = Number(item_2.Item2)
x2_3 = Number(item_2.Item3)
w2_2 = Number(item_2.Item8)
type_2 = Number(item_2.Item4)
y2_3 = Number(item_2.Item6)
z1_3 = Number(item_2.Item7)
w1_2 = Number(item_2.Item)
h1_2 = Number(item_2.Item1)
y1_3 = Number(item_2.Item5)

# ---- group: -y- (+) / -y- Inputs
w1_3 = Number(item.Item)
y2_4 = Number(item.Item6)
type_3 = Number(item.Item4)
y1_4 = Number(item.Item5)

# ---- group: -x- (+) / -x- imputs
# Translation vector
type_4 = Number(item.Item4)
x2_4 = Number(item.Item3)
y1_5 = Number(item.Item5)
w2_3 = Number(item.Item8)
w1_4 = Number(item.Item)
x1_4 = Number(item.Item2)
y2_5 = Number(item.Item6)

# ---- group: -z- (+) / -z- Inputs
h1_3 = Number(item.Item1)
z1_4 = Number(item.Item7)

# ---- group: -y- (-) / -y- Inputs
w1_5 = Number(item_2.Item)
y2_6 = Number(item_2.Item6)
type_5 = Number(item_2.Item4)
y1_6 = Number(item_2.Item5)

# ---- group: -x- (-) / -x- imputs
type_6 = Number(item_2.Item4)
y1_7 = Number(item_2.Item5)
w2_4 = Number(item_2.Item8)
x2_5 = Number(item_2.Item3)
w1_6 = Number(item_2.Item)
x1_5 = Number(item_2.Item2)
y2_7 = Number(item_2.Item6)

# ---- group: -z- (-) / -z- Inputs
h1_4 = Number(item_2.Item1)
z1_5 = Number(item_2.Item7)

# ---- group: -x- (+) / -x- 4,6,10,11,13,14
eval_5 = Evaluate(F="w2/2-x1*w2-x2*w2", w2=w2_3, x1=x1_4, x2=x2_4)
panel_3 = Panel(eval_5)

# ---- group: -x- (+) / -x- 1,2,3,7,8,9
eval_6 = Evaluate(F="w2/2-x1*w2", w2=w2_3, x1=x1_4)
panel_4 = Panel(eval_6)

# ---- group: -y- (+) / -y- 1,2,3
eval_7 = Evaluate(F="-w1/2", w1=w1_3)
panel_5 = Panel(eval_7)

# ---- group: -z- (+) / -z- 3,4,5,6,7
eval_8 = Evaluate(F="h1/2", h1=h1_3)
panel_6 = Panel(eval_8)

# ---- group: -z- (+) / -z- 1,9,10,14
eval_9 = Evaluate(F="-h1/2", h1=h1_3)
panel_7 = Panel(eval_9)

# ---- group: -y- (+) / -y- 5,12
python = GhPythonScript(Type=type_3, w1=w1_3, y1=y1_4, y2=y2_4)  # -> out, y
# ---------- python: Python ----------
__author__ = "davidet"
__version__ = "2021.02.17"

import rhinoscriptsyntax as rs

if y1==0:
    Type=1
if y2==0:
    Type=1

"""Se flat, sta nel mezzo tra 4-6"""
if Type==1:
    y=((-w1/2+y1*w1)+(w1/2-y2*w1))/2
else:
    y=-w1/2+w1/y2*(1/y1+1/y2)**(-1)
# ---------- end python ----------
panel_8 = Panel(python.y)

# ---- group: -x- (-) / -x- 4,6,10,11,13,14
eval_10 = Evaluate(F="-(w2/2-x1*w2-x2*w2)", w2=w2_4, x1=x1_5, x2=x2_5)
panel_9 = Panel(eval_10)

# ---- group: -y- (+) / -y- 4,13,4
eval_11 = Evaluate(F="-w1/2+y1*w1", w1=w1_3, y1=y1_4)
panel_10 = Panel(eval_11)

# ---- group: -x- (-) / -x- 1,2,3,7,8,9
eval_12 = Evaluate(F="-(w2/2-x1*w2)", w2=w2_4, x1=x1_5)
panel_11 = Panel(eval_12)

# ---- group: -y- (-) / -y- 1,2,3
eval_13 = Evaluate(F="-w1/2", w1=w1_5)
panel_12 = Panel(eval_13)

# ---- group: -z- (-) / -z- 1,9,10,14
eval_14 = Evaluate(F="-h1/2", h1=h1_4)
panel_13 = Panel(eval_14)

# ---- group: -z- (-) / -z- 3,4,5,6,7
eval_15 = Evaluate(F="h1/2", h1=h1_4)
panel_14 = Panel(eval_15)

# ---- group: -y- (-) / -y- 5,12
python_2 = GhPythonScript(Type=type_5, w1=w1_5, y1=y1_6, y2=y2_6)  # -> out, y; same code as python
panel_15 = Panel(python_2.y)

# ---- group: -y- (-) / -y- 4,13,4
eval_16 = Evaluate(F="-w1/2+y1*w1", w1=w1_5, y1=y1_6)
panel_16 = Panel(eval_16)

# ---- group: -x- (+) / -x- 1A,3A,7A,9A
eval_17 = Evaluate(F="w2/2", w2=w2_3)
panel_17 = Panel(eval_17)

# ---- group: -x- (+) / -x- 5,12
python_3 = GhPythonScript(Type=type_4, w1=w1_4, w2=w2_3, x1=x1_4, x2=x2_4, y1=y1_5, y2=y2_5)  # -> out, x
# ---------- python_3: Python ----------
__author__ = "davidet"
__version__ = "2021.02.17"

import rhinoscriptsyntax as rs

if y1==0:
    Type=1
if y2==0:
    Type=1

"""Se Flat"""
if Type==1:
    x=w2/2-x1*w2-x2*w2
else:
    x=w2/2-w1/y2*(1/y1+1/y2)**(-1)*(x2*w2)/(y1*w1)-x1*w2

print(x)
# ---------- end python_3 ----------
panel_18 = Panel(python_3.x)

# ---- group: -z- (+) / -z- 2,8,11,12,13
eval_18 = Evaluate(F="h1/2-z1*h1", h1=h1_3, z1=z1_4)
panel_19 = Panel(eval_18)

# ---- group: -y- (+) / -y- 7,8,9
eval_19 = Evaluate(F="w1/2", w1=w1_3)
panel_20 = Panel(eval_19)

# ---- group: -x- (-) / -x- 1A,3A,7A,9A
eval_20 = Evaluate(F="-(w2/2)", w2=w2_4)
panel_21 = Panel(eval_20)

# ---- group: -y- (+) / -y- 6,10,11
eval_21 = Evaluate(F="w1/2-y2*w1", w1=w1_3, y2=y2_4)
panel_22 = Panel(eval_21)

# ---- group: -x- (-) / -x- 5,12
python_4 = GhPythonScript(Type=type_6, w1=w1_6, w2=w2_4, x1=x1_5, x2=x2_5, y1=y1_7, y2=y2_7)  # -> out, x
# ---------- python_4: Python ----------
__author__ = "davidet"
__version__ = "2021.02.17"

import rhinoscriptsyntax as rs

if y1==0:
    Type=1
if y2==0:
    Type=1

"""Se Flat"""
if Type==1:
    x=-w2/2+x1*w2+x2*w2
else:
    x=-w2/2+w1/y2*(1/y1+1/y2)**(-1)*(x2*w2)/(y1*w1)+x1*w2

print(x)
# ---------- end python_4 ----------
panel_23 = Panel(python_4.x)

# ---- group: -z- (-) / -z- 2,8,11,12,13
eval_22 = Evaluate(F="h1/2-z1*h1", h1=h1_4, z1=z1_5)
panel_24 = Panel(eval_22)

# ---- group: -z- 12
x_13 = Number(eval_5)
x_13_2 = Number(eval_10)
z_13 = Number(eval_18)
x_5 = Number(python_3.x)
x_5_2 = Number(python_4.x)
z_13_2 = Number(eval_22)
python_5 = GhPythonScript(x=x_13, y=x_13_2, z=z_13, u=z_13_2, v=x_5, w=x_5_2)  # -> out, zn, zp
# ---------- python_5: Python ----------
__author__ = "davidet"
__version__ = "2021.02.23"

import rhinoscriptsyntax as rs

dx=x-y
dz=z-u

zn=dz/dx*(y-w)+u
zp=dz/dx*(dx-(x-v))+u

print(dx)
print(dz)
print(zp)
# ---------- end python_5 ----------

# ---- group: -y- (-) / -y- 7,8,9
eval_23 = Evaluate(F="w1/2", w1=w1_5)
panel_25 = Panel(eval_23)

# ---- group: -y- (-) / -y- 6,10,11
eval_24 = Evaluate(F="w1/2-y2*w1", w1=w1_5, y2=y2_6)
panel_26 = Panel(eval_24)

# ---- group: Check
eval_25 = Evaluate(F="if(-x+y<0,\"ERROR\",\"OK\")", x=python_4.x, y=python_3.x, z=w2_mm)
check_geometry_5 = Panel(eval_25)

eval_26 = Evaluate(F="if(x>y/2,\"ERROR\",\"OK\")", x=python_3.x, y=w2_3)
check_geometry_6 = Panel(eval_26)

eval_27 = Evaluate(F="if(-x>y/2,\"ERROR\",\"OK\")", x=python_4.x, y=w2_4)
check_geometry_7 = Panel(eval_27)

# ---- group: Control pts. (+) / 4 (+)
pt = Point(Point(0, 0, 0))
vec = VectorXYZ(XComponent=eval_5, YComponent=eval_11, ZComponent=eval_8)  # -> Vector, Length
move = Move(Geometry=pt, Motion=vec.Vector)  # -> Geometry, Transform

# ---- group: Control pts. (+) / 3 (+)
pt_2 = Point(Point(0, 0, 0))
vec_2 = VectorXYZ(XComponent=eval_6, YComponent=eval_7, ZComponent=eval_8)  # -> Vector, Length
move_2 = Move(Geometry=pt_2, Motion=vec_2.Vector)  # -> Geometry, Transform

# ---- group: Control pts. (+) / 1 (+)
pt_3 = Point(Point(0, 0, 0))
vec_3 = VectorXYZ(XComponent=eval_6, YComponent=eval_7, ZComponent=eval_9)  # -> Vector, Length
# Points definition
move_3 = Move(Geometry=pt_3, Motion=vec_3.Vector)  # -> Geometry, Transform

# ---- group: Control pts. (+) / 2 (+)
pt_4 = Point(Point(0, 0, 0))
vec_4 = VectorXYZ(XComponent=eval_6, YComponent=eval_7, ZComponent=eval_18)  # -> Vector, Length
move_4 = Move(Geometry=pt_4, Motion=vec_4.Vector)  # -> Geometry, Transform

# ---- group: Control pts. (+) / 5 (+)
pt_5 = Point(Point(0, 0, 0))
vec_5 = VectorXYZ(XComponent=python_3.x, YComponent=python.y, ZComponent=eval_8)  # -> Vector, Length
move_5 = Move(Geometry=pt_5, Motion=vec_5.Vector)  # -> Geometry, Transform

# ---- group: Control pts. (-) / 4 (+)
pt_6 = Point(Point(0, 0, 0))
vec_6 = VectorXYZ(XComponent=eval_10, YComponent=eval_16, ZComponent=eval_15)  # -> Vector, Length
move_6 = Move(Geometry=pt_6, Motion=vec_6.Vector)  # -> Geometry, Transform

# ---- group: Control pts. (-) / 3 (+)
pt_7 = Point(Point(0, 0, 0))
vec_7 = VectorXYZ(XComponent=eval_12, YComponent=eval_13, ZComponent=eval_15)  # -> Vector, Length
move_7 = Move(Geometry=pt_7, Motion=vec_7.Vector)  # -> Geometry, Transform

# ---- group: Control pts. (-) / 1 (+)
pt_8 = Point(Point(0, 0, 0))
vec_8 = VectorXYZ(XComponent=eval_12, YComponent=eval_13, ZComponent=eval_14)  # -> Vector, Length
move_8 = Move(Geometry=pt_8, Motion=vec_8.Vector)  # -> Geometry, Transform

# ---- group: Control pts. (-) / 2 (+)
pt_9 = Point(Point(0, 0, 0))
vec_9 = VectorXYZ(XComponent=eval_12, YComponent=eval_13, ZComponent=eval_22)  # -> Vector, Length
move_9 = Move(Geometry=pt_9, Motion=vec_9.Vector)  # -> Geometry, Transform

# ---- group: Control pts. (-) / 5 (+)
pt_10 = Point(Point(0, 0, 0))
vec_10 = VectorXYZ(XComponent=python_4.x, YComponent=python_2.y, ZComponent=eval_15)  # -> Vector, Length
move_10 = Move(Geometry=pt_10, Motion=vec_10.Vector)  # -> Geometry, Transform

# ---- group: Control pts. (+) / 1A (+)
pt_11 = Point(Point(0, 0, 0))
vec_11 = VectorXYZ(XComponent=eval_17, YComponent=eval_7, ZComponent=eval_9)  # -> Vector, Length
move_11 = Move(Geometry=pt_11, Motion=vec_11.Vector)  # -> Geometry, Transform

# ---- group: Control pts. (-) / 1A (+)
pt_12 = Point(Point(0, 0, 0))
vec_12 = VectorXYZ(XComponent=eval_20, YComponent=eval_13, ZComponent=eval_14)  # -> Vector, Length
move_12 = Move(Geometry=pt_12, Motion=vec_12.Vector)  # -> Geometry, Transform

# ---- group: Control pts. (+) / 6 (+)
pt_13 = Point(Point(0, 0, 0))
vec_13 = VectorXYZ(XComponent=eval_5, YComponent=eval_21, ZComponent=eval_8)  # -> Vector, Length
move_13 = Move(Geometry=pt_13, Motion=vec_13.Vector)  # -> Geometry, Transform

# ---- group: Control pts. (+) / 7 (+)
pt_14 = Point(Point(0, 0, 0))
vec_14 = VectorXYZ(XComponent=eval_6, YComponent=eval_19, ZComponent=eval_8)  # -> Vector, Length
move_14 = Move(Geometry=pt_14, Motion=vec_14.Vector)  # -> Geometry, Transform

# ---- group: Control pts. (+) / 8 (+)
pt_15 = Point(Point(0, 0, 0))
vec_15 = VectorXYZ(XComponent=eval_6, YComponent=eval_19, ZComponent=eval_18)  # -> Vector, Length
move_15 = Move(Geometry=pt_15, Motion=vec_15.Vector)  # -> Geometry, Transform

# ---- group: Control pts. (+) / 9 (+)
pt_16 = Point(Point(0, 0, 0))
vec_16 = VectorXYZ(XComponent=eval_6, YComponent=eval_19, ZComponent=eval_9)  # -> Vector, Length
move_16 = Move(Geometry=pt_16, Motion=vec_16.Vector)  # -> Geometry, Transform

# ---- group: Control pts. (+) / 10 (+)
pt_17 = Point(Point(0, 0, 0))
vec_17 = VectorXYZ(XComponent=eval_5, YComponent=eval_21, ZComponent=eval_9)  # -> Vector, Length
move_17 = Move(Geometry=pt_17, Motion=vec_17.Vector)  # -> Geometry, Transform

# ---- group: Control pts. (-) / 6 (+)
pt_18 = Point(Point(0, 0, 0))
vec_18 = VectorXYZ(XComponent=eval_10, YComponent=eval_24, ZComponent=eval_15)  # -> Vector, Length
move_18 = Move(Geometry=pt_18, Motion=vec_18.Vector)  # -> Geometry, Transform

# ---- group: Control pts. (-) / 7 (+)
pt_19 = Point(Point(0, 0, 0))
vec_19 = VectorXYZ(XComponent=eval_12, YComponent=eval_23, ZComponent=eval_15)  # -> Vector, Length
move_19 = Move(Geometry=pt_19, Motion=vec_19.Vector)  # -> Geometry, Transform

# ---- group: Control pts. (-) / 8 (+)
pt_20 = Point(Point(0, 0, 0))
vec_20 = VectorXYZ(XComponent=eval_12, YComponent=eval_23, ZComponent=eval_22)  # -> Vector, Length
move_20 = Move(Geometry=pt_20, Motion=vec_20.Vector)  # -> Geometry, Transform

# ---- group: Control pts. (-) / 9 (+)
pt_21 = Point(Point(0, 0, 0))
vec_21 = VectorXYZ(XComponent=eval_12, YComponent=eval_23, ZComponent=eval_14)  # -> Vector, Length
move_21 = Move(Geometry=pt_21, Motion=vec_21.Vector)  # -> Geometry, Transform

# ---- group: Control pts. (+) / 3A (+)
pt_22 = Point(Point(0, 0, 0))
vec_22 = VectorXYZ(XComponent=eval_17, YComponent=eval_7, ZComponent=eval_8)  # -> Vector, Length
move_22 = Move(Geometry=pt_22, Motion=vec_22.Vector)  # -> Geometry, Transform

# ---- group: Control pts. (-) / 10 (+)
pt_23 = Point(Point(0, 0, 0))
vec_23 = VectorXYZ(XComponent=eval_10, YComponent=eval_24, ZComponent=eval_14)  # -> Vector, Length
move_23 = Move(Geometry=pt_23, Motion=vec_23.Vector)  # -> Geometry, Transform

# ---- group: Control pts. (-) / 3A (+)
pt_24 = Point(Point(0, 0, 0))
vec_24 = VectorXYZ(XComponent=eval_20, YComponent=eval_13, ZComponent=eval_15)  # -> Vector, Length
move_24 = Move(Geometry=pt_24, Motion=vec_24.Vector)  # -> Geometry, Transform

# ---- group: Control pts. (+) / 11 (+)
pt_25 = Point(Point(0, 0, 0))
vec_25 = VectorXYZ(XComponent=eval_5, YComponent=eval_21, ZComponent=eval_18)  # -> Vector, Length
move_25 = Move(Geometry=pt_25, Motion=vec_25.Vector)  # -> Geometry, Transform

# ---- group: Control pts. (+) / 12 (+)
pt_26 = Point(Point(0, 0, 0))
vec_26 = VectorXYZ(XComponent=python_3.x, YComponent=python.y, ZComponent=python_5.zp)  # -> Vector, Length
move_26 = Move(Geometry=pt_26, Motion=vec_26.Vector)  # -> Geometry, Transform

# ---- group: Control pts. (+) / 13 (+)
pt_27 = Point(Point(0, 0, 0))
vec_27 = VectorXYZ(XComponent=eval_5, YComponent=eval_11, ZComponent=eval_18)  # -> Vector, Length
move_27 = Move(Geometry=pt_27, Motion=vec_27.Vector)  # -> Geometry, Transform

# ---- group: Control pts. (+) / 14 (+)
pt_28 = Point(Point(0, 0, 0))
vec_28 = VectorXYZ(XComponent=eval_5, YComponent=eval_11, ZComponent=eval_9)  # -> Vector, Length
move_28 = Move(Geometry=pt_28, Motion=vec_28.Vector)  # -> Geometry, Transform

# ---- group: Control pts. (-) / 11 (+)
pt_29 = Point(Point(0, 0, 0))
vec_29 = VectorXYZ(XComponent=eval_10, YComponent=eval_24, ZComponent=eval_22)  # -> Vector, Length
move_29 = Move(Geometry=pt_29, Motion=vec_29.Vector)  # -> Geometry, Transform

# ---- group: Check CNC / Check 8-11
vec2pt = Vector2Pt(PointA=move_25.Geometry, PointB=move_15.Geometry, Unitize=False)  # -> Vector, Length
vec2pt_2 = Vector2Pt(PointA=move_29.Geometry, PointB=move_20.Geometry, Unitize=False)  # -> Vector, Length
vec2pt_3 = Vector2Pt(PointA=move_25.Geometry, PointB=move_29.Geometry, Unitize=False)  # -> Vector, Length
vec2pt_4 = Vector2Pt(PointA=move_29.Geometry, PointB=move_25.Geometry, Unitize=False)  # -> Vector, Length
angle = Angle(VectorA=vec2pt_4.Vector, VectorB=vec2pt_2.Vector)  # -> expr("x/pi*180", Angle), Reflex
angle_2 = Angle(VectorA=vec2pt.Vector, VectorB=vec2pt_3.Vector)  # -> expr("x/pi*180", Angle), Reflex
panel_27 = Panel(angle.Angle)
panel_28 = Panel(angle_2.Angle)

# ---- group: Control pts. (-) / 12 (+)
pt_30 = Point(Point(0, 0, 0))
vec_30 = VectorXYZ(XComponent=python_4.x, YComponent=python_2.y, ZComponent=python_5.zn)  # -> Vector, Length
move_30 = Move(Geometry=pt_30, Motion=vec_30.Vector)  # -> Geometry, Transform

# ---- group: Control pts. (-) / 13 (+)
pt_31 = Point(Point(0, 0, 0))
vec_31 = VectorXYZ(XComponent=eval_10, YComponent=eval_16, ZComponent=eval_22)  # -> Vector, Length
move_31 = Move(Geometry=pt_31, Motion=vec_31.Vector)  # -> Geometry, Transform

# ---- group: Check CNC / Check 2-13
vec2pt_5 = Vector2Pt(PointA=move_27.Geometry, PointB=move_4.Geometry, Unitize=False)  # -> Vector, Length
vec2pt_6 = Vector2Pt(PointA=move_27.Geometry, PointB=move_31.Geometry, Unitize=False)  # -> Vector, Length
vec2pt_7 = Vector2Pt(PointA=move_31.Geometry, PointB=move_9.Geometry, Unitize=False)  # -> Vector, Length
vec2pt_8 = Vector2Pt(PointA=move_31.Geometry, PointB=move_27.Geometry, Unitize=False)  # -> Vector, Length
angle_3 = Angle(VectorA=vec2pt_7.Vector, VectorB=vec2pt_8.Vector)  # -> expr("x/pi*180", Angle), Reflex
angle_4 = Angle(VectorA=vec2pt_5.Vector, VectorB=vec2pt_6.Vector)  # -> expr("x/pi*180", Angle), Reflex
panel_29 = Panel(angle_3.Angle)
panel_30 = Panel(angle_4.Angle)

# ---- group: Control pts. (-) / 14 (+)
pt_32 = Point(Point(0, 0, 0))
vec_32 = VectorXYZ(XComponent=eval_10, YComponent=eval_16, ZComponent=eval_14)  # -> Vector, Length
move_32 = Move(Geometry=pt_32, Motion=vec_32.Vector)  # -> Geometry, Transform

# ---- group: Control pts. (+) / 7A (+)
pt_33 = Point(Point(0, 0, 0))
vec_33 = VectorXYZ(XComponent=eval_17, YComponent=eval_19, ZComponent=eval_8)  # -> Vector, Length
move_33 = Move(Geometry=pt_33, Motion=vec_33.Vector)  # -> Geometry, Transform

# ---- group: Control pts. (-) / 7A (+)
pt_34 = Point(Point(0, 0, 0))
vec_34 = VectorXYZ(XComponent=eval_20, YComponent=eval_23, ZComponent=eval_15)  # -> Vector, Length
move_34 = Move(Geometry=pt_34, Motion=vec_34.Vector)  # -> Geometry, Transform

# ---- group: Control pts. (+) / 9A (+)
pt_35 = Point(Point(0, 0, 0))
vec_35 = VectorXYZ(XComponent=eval_17, YComponent=eval_19, ZComponent=eval_9)  # -> Vector, Length
move_35 = Move(Geometry=pt_35, Motion=vec_35.Vector)  # -> Geometry, Transform

# ---- group: Control pts. (-) / 9A (+)
pt_36 = Point(Point(0, 0, 0))
vec_36 = VectorXYZ(XComponent=eval_20, YComponent=eval_23, ZComponent=eval_14)  # -> Vector, Length
move_36 = Move(Geometry=pt_36, Motion=vec_36.Vector)  # -> Geometry, Transform

# ---- group: Control pts. (+) / Preview
merge_8 = Merge(
    Data1=move_3.Geometry,
    Data2=move_4.Geometry,
    Data3=move_2.Geometry,
    Data4=move.Geometry,
    Data5=move_5.Geometry,
    Data6=move_13.Geometry,
    Data7=move_14.Geometry,
    Data8=move_15.Geometry,
    Data9=move_16.Geometry,
    Data10=move_17.Geometry,
    Data11=move_25.Geometry,
    Data12=move_26.Geometry,
    Data13=move_27.Geometry,
    Data14=move_28.Geometry,
    Data15=move_11.Geometry,
    Data16=move_22.Geometry,
    Data17=move_33.Geometry,
    Data18=move_35.Geometry)
panel_31 = Panel("""1(+)
2(+)
3(+)
4(+)
5(+)
6(+)
7(+)
8(+)
9(+)
10(+)
11(+)
12(+)
13(+)
14(+)
1A(+)
3A(+)
7A(+)
9A(+)""")
tag = TextTag(Location=merge_8, Text=panel_31, Colour=ColourSwatch(SwatchColor=RGB(0, 0, 0)))

# ---- group: Check CNC / Check
eval_28 = Evaluate(F="if(x>=90,0,1)", x=[angle_4.Angle, angle_3.Angle, angle_2.Angle, angle.Angle])
ma = MassAddition(Input=eval_28)  # -> Result, PartialResults
eval_29 = Evaluate(F="if(x<1,\"OK\",\"ERROR\")", x=ma.Result)
check_cnc = Panel(eval_29)

# ---- group: Check
merge_9 = Merge(Data1=eval_4, Data2=eval, Data3=eval_26, Data4=eval_3, Data5=eval_2, Data6=eval_27, Data7=eval_25, Data8=eval_29)

# ---- group: Control pts. (-) / Preview
merge_10 = Merge(
    Data1=move_8.Geometry,
    Data2=move_9.Geometry,
    Data3=move_7.Geometry,
    Data4=move_6.Geometry,
    Data5=move_10.Geometry,
    Data6=move_18.Geometry,
    Data7=move_19.Geometry,
    Data8=move_20.Geometry,
    Data9=move_21.Geometry,
    Data10=move_23.Geometry,
    Data11=move_29.Geometry,
    Data12=move_30.Geometry,
    Data13=move_31.Geometry,
    Data14=move_32.Geometry,
    Data15=move_12.Geometry,
    Data16=move_24.Geometry,
    Data17=move_34.Geometry,
    Data18=move_36.Geometry)
panel_32 = Panel("""1(-)
2(-)
3(-)
4(-)
5(-)
6(-)
7(-)
8(-)
9(-)
10(-)
11()
12(-)
13(-)
14(-)
1A(-)
3A(-)
7A(-)
9A(-)""")
tag_2 = TextTag(Location=merge_10, Text=panel_32, Colour=ColourSwatch(SwatchColor=RGB(0, 0, 0)))

# ---- group: Cap (+) / Top Cap
panel_33 = Panel("""2
3
4
5
6
16
15""")
item_3 = ListItem(List=merge_8, Index=panel_33, Wrap=True)
pline = PolyLine(Vertices=item_3, Closed=invert(False))
boundary = BoundarySurfaces(Edges=pline)

# ---- group: Contact faces (+) / Geometry 1A
panel_34 = Panel("""0
2
15
14""")
item_4 = ListItem(List=merge_8, Index=panel_34, Wrap=True)
pline_2 = PolyLine(Vertices=item_4, Closed=invert(False))
boundary_2 = BoundarySurfaces(Edges=pline_2)

# ---- group: Extra Beam 1 / Geometry Extra Beam 1 (+)
item_5 = ListItem(List=merge_8, Index="14", Wrap=True)  # -> Item, Item1, Item2, Item3
pline_3 = PolyLine(Vertices=[item_5.Item, item_5.Item1, item_5.Item2, item_5.Item3], Closed=invert(False))
X = UnitX(Factor="200")
extr = Extrude(Base=pline_3, Direction=X)
cap = CapHoles(Brep=extr)

# ---- group: Preview / Preview singola old
# Surface & Preview
python_6 = GhPythonScript(x=merge_9)  # -> out, a
# ---------- python_6: Python ----------
__author__ = "davidet"
__version__ = "2021.02.18"

import rhinoscriptsyntax as rs

if x=="ERROR":
    a=1
else:
    a=0
# ---------- end python_6 ----------
swatch = ColourSwatch(SwatchColor=RGB(120, 120, 120))
ma_2 = MassAddition(Input=python_6.a)  # -> Result, PartialResults
python_7 = GhPythonScript(x=ma_2.Result)  # -> out, a, b
# ---------- python_7: Python ----------
__author__ = "davidet"
__version__ = "2021.02.18"

import rhinoscriptsyntax as rs

if x==0:
    a="120"
    b="120"
else:
    a="255"
    b="0"
# ---------- end python_7 ----------
rgb = ColourRGB(Alpha="180", Red=python_7.a, Green=python_7.b, Blue=python_7.b)
rgb_2 = ColourRGB(Alpha="40", Red="120", Green="120", Blue="120")

# ---- group: Contact faces (+) / Geometry 1
panel_35 = Panel("""0
2
3
13""")
item_6 = ListItem(List=merge_8, Index=panel_35, Wrap=True)
pline_4 = PolyLine(Vertices=item_6, Closed=invert(False))
boundary_3 = BoundarySurfaces(Edges=pline_4)

# ---- group: Contact faces (+) / Geometry 3
panel_36 = Panel("""3
4
11
12""")
item_7 = ListItem(List=merge_8, Index=panel_36, Wrap=True)
pline_5 = PolyLine(Vertices=item_7, Closed=invert(False))
boundary_4 = BoundarySurfaces(Edges=pline_5)

# ---- group: Cap (-) / Top Cap
panel_37 = Panel("""2
3
4
5
6
16
15""")
item_8 = ListItem(List=merge_10, Index=panel_37, Wrap=True)
pline_6 = PolyLine(Vertices=item_8, Closed=invert(False))
boundary_5 = BoundarySurfaces(Edges=pline_6)

# ---- group: Extra Beam 1 / Geometry Extra Beam 1 (-)
item_9 = ListItem(List=merge_10, Index="14", Wrap=True)  # -> Item, Item1, Item2, Item3
pline_7 = PolyLine(Vertices=[item_9.Item, item_9.Item1, item_9.Item2, item_9.Item3], Closed=invert(False))
X_2 = UnitX(Factor="-200")
extr_2 = Extrude(Base=pline_7, Direction=X_2)
cap_2 = CapHoles(Brep=extr_2)

# ---- group: Middle part / V (+)
panel_38 = Panel("""12
13""")
panel_39 = Panel("""13
12""")
item_10 = ListItem(List=merge_10, Index=panel_38, Wrap=True)
item_11 = ListItem(List=merge_8, Index=panel_39, Wrap=True)
pline_8 = PolyLine(Vertices=[item_10, item_11], Closed=invert(False))
boundary_6 = BoundarySurfaces(Edges=pline_8)

# ---- group: Contact faces (-) / Geometry 1A
panel_40 = Panel("""0
2
15
14""")
item_12 = ListItem(List=merge_10, Index=panel_40, Wrap=True)
pline_9 = PolyLine(Vertices=item_12, Closed=invert(False))
boundary_7 = BoundarySurfaces(Edges=pline_9)

# ---- group: Middle part / Top middle part
panel_41 = Panel("""10
11
12""")
panel_42 = Panel("""12
11
10""")
item_13 = ListItem(List=merge_10, Index=panel_41, Wrap=True)
item_14 = ListItem(List=merge_8, Index=panel_42, Wrap=True)
pline_10 = PolyLine(Vertices=[item_13, item_14], Closed=invert(False))
boundary_8 = BoundarySurfaces(Edges=pline_10)

# ---- group: Contact faces (-) / Geometry 1
panel_43 = Panel("""0
2
3
13""")
item_15 = ListItem(List=merge_10, Index=panel_43, Wrap=True)
pline_11 = PolyLine(Vertices=item_15, Closed=invert(False))
boundary_9 = BoundarySurfaces(Edges=pline_11)

# ---- group: Contact faces (-) / Geometry 3
panel_44 = Panel("""3
4
11
12""")
item_16 = ListItem(List=merge_10, Index=panel_44, Wrap=True)
pline_12 = PolyLine(Vertices=item_16, Closed=invert(False))
boundary_10 = BoundarySurfaces(Edges=pline_12)

# ---- group: Cap (+) / Bottom Cap
panel_45 = Panel("""0
14
17
8
9
13""")
item_17 = ListItem(List=merge_8, Index=panel_45, Wrap=True)
pline_13 = PolyLine(Vertices=item_17, Closed=invert(False))
boundary_11 = BoundarySurfaces(Edges=pline_13)

# ---- group: Contact faces (+) / Geometry 2A
panel_46 = Panel("""6
8
17
16""")
item_18 = ListItem(List=merge_8, Index=panel_46, Wrap=True)
pline_14 = PolyLine(Vertices=item_18, Closed=invert(False))
boundary_12 = BoundarySurfaces(Edges=pline_14)

# ---- group: Contact faces (+) / Geometry 2
panel_47 = Panel("""5
6
8
9""")
item_19 = ListItem(List=merge_8, Index=panel_47, Wrap=True)
pline_15 = PolyLine(Vertices=item_19, Closed=invert(False))
boundary_13 = BoundarySurfaces(Edges=pline_15)

# ---- group: Cap (-) / Bottom Cap
panel_48 = Panel("""0
14
17
8
9
13""")
item_20 = ListItem(List=merge_10, Index=panel_48, Wrap=True)
pline_16 = PolyLine(Vertices=item_20, Closed=invert(False))
boundary_14 = BoundarySurfaces(Edges=pline_16)

# ---- group: Middle part / V (-)
panel_49 = Panel("""9
10""")
panel_50 = Panel("""10
9""")
item_21 = ListItem(List=merge_10, Index=panel_49, Wrap=True)
item_22 = ListItem(List=merge_8, Index=panel_50, Wrap=True)
pline_17 = PolyLine(Vertices=[item_21, item_22], Closed=invert(False))
boundary_15 = BoundarySurfaces(Edges=pline_17)

# ---- group: Middle part / Bottom middle srf.
panel_51 = Panel("""9
13""")
panel_52 = Panel("""13
9""")
item_23 = ListItem(List=merge_10, Index=panel_51, Wrap=True)
item_24 = ListItem(List=merge_8, Index=panel_52, Wrap=True)
pline_18 = PolyLine(Vertices=[item_23, item_24], Closed=invert(False))
boundary_16 = BoundarySurfaces(Edges=pline_18)

# ---- group: Contact faces (+) / Geometry 4
panel_53 = Panel("""4
5
10
11""")
item_25 = ListItem(List=merge_8, Index=panel_53, Wrap=True)
pline_19 = PolyLine(Vertices=item_25, Closed=invert(False))
boundary_17 = BoundarySurfaces(Edges=pline_19)

# ---- group: Contact faces (-) / Geometry 2A
panel_54 = Panel("""6
8
17
16""")
item_26 = ListItem(List=merge_10, Index=panel_54, Wrap=True)
pline_20 = PolyLine(Vertices=item_26, Closed=invert(False))
boundary_18 = BoundarySurfaces(Edges=pline_20)

# ---- group: Contact faces (-) / Geometry 2
panel_55 = Panel("""5
6
8
9""")
item_27 = ListItem(List=merge_10, Index=panel_55, Wrap=True)
pline_21 = PolyLine(Vertices=item_27, Closed=invert(False))
boundary_19 = BoundarySurfaces(Edges=pline_21)

# ---- group: Contact faces (-) / Geometry 4
panel_56 = Panel("""4
5
10
11""")
item_28 = ListItem(List=merge_10, Index=panel_56, Wrap=True)
pline_22 = PolyLine(Vertices=item_28, Closed=invert(False))
boundary_20 = BoundarySurfaces(Edges=pline_22)

# ----
wires = BrepWireframe(Brep=extr, Density=-1)
wires_2 = BrepWireframe(Brep=extr_2, Density=-1)

# ---- group: Extra Beam 1 / Preview Extra Beam 1 (+)
preview = CustomPreview(Geometry=wires, Material=rgb_2)

# ---- group: Extra Beam 1 / Preview Extra Beam 1 (-)
preview_2 = CustomPreview(Geometry=wires_2, Material=rgb_2)

# ---- group: Contact faces (-) / Preview
srf = Surface([boundary_7, boundary_18, boundary_9, boundary_19, boundary_20, boundary_10])
area = Area(Geometry=srf)  # -> Area, Centroid
panel_57 = Panel("""1A
2A
1
2
3
4""")
preview_3 = CustomPreview(Geometry=srf, Material=rgb)  # disabled
tag_3 = TextTag(Location=area.Centroid, Text=panel_57)

# ----
edges = BrepEdges(Brep=srf)  # -> flatten(Naked), Interior, NonManifold
preview_4 = CustomPreview(Geometry=edges.Naked, Material=rgb)  # disabled

# ---- group: Surface -x- / Project srf. B
pt_37 = ConstructPoint(XCoordinate=eval_20, YCoordinate=0, ZCoordinate=0)
panel_58 = Panel("""2
3
4
5""")
X_3 = UnitX(Factor=1)
item_29 = ListItem(List=srf, Index=panel_58, Wrap=True)
yz = YZPlane(Origin=pt_37)
projecta = ProjectAlong(Geometry=item_29, Plane=yz, Direction=X_3)  # -> Geometry, Transform

# ---- group: Cnt. Srf. X(-)
geo = Geometry(projecta.Geometry)
X_4 = UnitX(Factor="-60")
move_37 = Move(Geometry=geo, Motion=X_4)  # -> Geometry, Transform
edges_2 = BrepEdges(Brep=move_37.Geometry)  # -> flatten(Naked), Interior, NonManifold

# ---- group: Cnt. Srf. Y (+)
pt_38 = Point([merge_8, merge_10])
Y = UnitY(Factor="80")

# ---- group: Cnt. Srf. X(+)
X_5 = UnitX(Factor="60")

# ---- group: Cnt. Srf. Y (+) / y
panel_59 = Panel("""6
16""")
item_30 = ListItem(List=pt_38, Index=panel_59, Wrap=True)
panel_60 = Panel("""24
34""")
item_31 = ListItem(List=pt_38, Index=panel_60, Wrap=True)
panel_61 = Panel("""16
34""")
item_32 = ListItem(List=pt_38, Index=panel_61, Wrap=True)
panel_62 = Panel("""5
6""")
item_33 = ListItem(List=pt_38, Index=panel_62, Wrap=True)
panel_63 = Panel("""23
24""")
item_34 = ListItem(List=pt_38, Index=panel_63, Wrap=True)
panel_64 = Panel("""4
5""")
item_35 = ListItem(List=pt_38, Index=panel_64, Wrap=True)
panel_65 = Panel("""22
23""")
item_36 = ListItem(List=pt_38, Index=panel_65, Wrap=True)
entwine = Entwine(
    Branch00="x1",
    Branch01="x2",
    Branch02="Type",
    Branch03="x3",
    Branch04="x4",
    Branch05="Type",
    Branch06="w2",
    FlattenInputs=True)  # -> flatten(Result)
entwine_2 = Entwine(
    Branch00=item_30,
    Branch01=item_33,
    Branch02=item_35,
    Branch03=item_31,
    Branch04=item_34,
    Branch05=item_36,
    Branch06=item_32,
    FlattenInputs=True)
panel_66 = Panel("""1
1
1
1
1
1
2""")
pline_23 = PolyLine(Vertices=entwine_2, Closed=False)
Y_2 = UnitY(Factor=1)
panel_67 = Panel("8")
Z = UnitZ(Factor=panel_67)
multiplication = Multiplication(A=Z, B=panel_66)
panel_68 = Panel("3")
Z_2 = UnitZ(Factor=panel_68)

# ---- group: Cnt. Srf. Y (+) / z
panel_69 = Panel("""16
17""")
item_37 = ListItem(List=pt_38, Index=panel_69, Wrap=True)
panel_70 = Panel("""0
1
2""")
panel_71 = Panel("""3
4
5""")
panel_72 = Panel("""4
11""")
item_38 = ListItem(List=pt_38, Index=panel_72, Wrap=True)
panel_73 = Panel("""22
29""")
item_39 = ListItem(List=pt_38, Index=panel_73, Wrap=True)
entwine_3 = Entwine(Branch00=item_37, Branch01=item_38, Branch02=item_39, FlattenInputs=True)
pline_24 = PolyLine(Vertices=entwine_3, Closed=False)
X_6 = UnitX(Factor=panel_67)
entwine_4 = Entwine(Branch00="h1", Branch01="z1", Branch02="z2", FlattenInputs=True)  # -> flatten(Result)
panel_74 = Panel("""2
1
-1""")
multiplication_2 = Multiplication(A=X_6, B=panel_74)
graft = GraftTree(Tree=multiplication_2, IncludeEmptyLists=True, IncludeNullItems=True)
X_7 = UnitX(Factor=panel_68)
panel_75 = Panel("""1
1
-1""")
multiplication_3 = Multiplication(A=X_7, B=panel_75)

# ---- group: Cnt. Srf. X(+)
panel_76 = Panel("""12
8
17
4""")
Y_3 = UnitY(Factor=expr("-x*2", "8"))
Z_3 = UnitZ(Factor="8")
Z_4 = UnitZ(Factor="8")
Z_5 = UnitZ(Factor=expr("x*2", "8"))
merge_11 = Merge(Data1="y2", Data2="y1", Data3="h1", Data4="z1", Data5="w1")

volume = Volume(Geometry=cap)  # -> Volume, Centroid
panel_77 = Panel("(+)")

# ---- group: Cnt. Srf. Y (+)
swatch_2 = ColourSwatch(SwatchColor=RGBA(144, 0, 45, 135))

# ---- group: Cnt. Srf. Y (-)
pt_39 = Point([merge_8, merge_10])
Y_4 = UnitY(Factor="-80")

# ---- group: Cnt. Srf. Y (-) / y
panel_78 = Panel("""6
16""")
item_40 = ListItem(List=pt_39, Index=panel_78, Wrap=True)
panel_79 = Panel("""24
34""")
item_41 = ListItem(List=pt_39, Index=panel_79, Wrap=True)
panel_80 = Panel("""16
34""")
item_42 = ListItem(List=pt_39, Index=panel_80, Wrap=True)
panel_81 = Panel("""5
6""")
item_43 = ListItem(List=pt_39, Index=panel_81, Wrap=True)
panel_82 = Panel("""23
24""")
item_44 = ListItem(List=pt_39, Index=panel_82, Wrap=True)
panel_83 = Panel("""4
5""")
item_45 = ListItem(List=pt_39, Index=panel_83, Wrap=True)
panel_84 = Panel("""22
23""")
item_46 = ListItem(List=pt_39, Index=panel_84, Wrap=True)
entwine_5 = Entwine(
    Branch00="x1",
    Branch01="x2",
    Branch02="Type",
    Branch03="x3",
    Branch04="x4",
    Branch05="Type",
    Branch06="w2",
    FlattenInputs=True)  # -> flatten(Result)
entwine_6 = Entwine(
    Branch00=item_40,
    Branch01=item_43,
    Branch02=item_45,
    Branch03=item_41,
    Branch04=item_44,
    Branch05=item_46,
    Branch06=item_42,
    FlattenInputs=True)
pline_25 = PolyLine(Vertices=entwine_6, Closed=False)
Y_5 = UnitY(Factor=1)
panel_85 = Panel("""1
1
1
1
1
1
2""")
panel_86 = Panel("8")
Z_6 = UnitZ(Factor=panel_86)
multiplication_4 = Multiplication(A=Z_6, B=panel_85)
panel_87 = Panel("3")
Z_7 = UnitZ(Factor=panel_87)

# ---- group: Cnt. Srf. Y (-) / z
panel_88 = Panel("""16
17""")
item_47 = ListItem(List=pt_39, Index=panel_88, Wrap=True)
panel_89 = Panel("""0
1
2""")
panel_90 = Panel("""3
4
5""")
panel_91 = Panel("""4
11""")
item_48 = ListItem(List=pt_39, Index=panel_91, Wrap=True)
panel_92 = Panel("""22
29""")
item_49 = ListItem(List=pt_39, Index=panel_92, Wrap=True)
entwine_7 = Entwine(Branch00=item_47, Branch01=item_48, Branch02=item_49, FlattenInputs=True)
pline_26 = PolyLine(Vertices=entwine_7, Closed=False)
X_8 = UnitX(Factor=panel_86)
entwine_8 = Entwine(Branch00="h1", Branch01="z1", Branch02="z2", FlattenInputs=True)  # -> flatten(Result)
panel_93 = Panel("""2
1
-1""")
multiplication_5 = Multiplication(A=X_8, B=panel_93)
graft_2 = GraftTree(Tree=multiplication_5, IncludeEmptyLists=True, IncludeNullItems=True)
X_9 = UnitX(Factor=panel_87)
panel_94 = Panel("""1
1
-1""")
multiplication_6 = Multiplication(A=X_9, B=panel_94)

# ---- group: Cnt. Srf. X(-)
panel_95 = Panel("""12
8
17
4""")
item_50 = ListItem(List=edges_2.Naked, Index=17, Wrap=True)
item_51 = ListItem(List=edges_2.Naked, Index=0, Wrap=True)
item_52 = ListItem(List=edges_2.Naked, Index=15, Wrap=True)
item_53 = ListItem(List=edges_2.Naked, Index=4, Wrap=True)
brep = Brep(move_37.Geometry)
item_54 = ListItem(List=edges_2.Naked, Index=panel_95, Wrap=True)
Y_6 = UnitY(Factor=expr("-x*2", "8"))
Z_8 = UnitZ(Factor="8")
len = Length(Curve=item_50)
Z_9 = UnitZ(Factor="8")
join = JoinCurves(Curves=item_54, Preserve=False)
move_38 = Move(Geometry=item_51, Motion=Y_6)  # -> Geometry, Transform
addition = Addition(A=len, B="8")
move_39 = Move(Geometry=item_50, Motion=Z_8)  # -> Geometry, Transform
move_40 = Move(Geometry=item_53, Motion=Z_9)  # -> Geometry, Transform
Z_10 = UnitZ(Factor=expr("x*2", "8"))
Y_7 = UnitY(Factor=expr("-x", addition))
move_41 = Move(Geometry=join, Motion=Z_10)  # -> Geometry, Transform
move_42 = Move(Geometry=item_52, Motion=Y_7)  # -> Geometry, Transform
merge_12 = Merge(Data1=move_40.Geometry, Data2=move_39.Geometry, Data3=move_41.Geometry, Data4=move_38.Geometry, Data5=move_42.Geometry)  # -> flatten(Result)
merge_13 = Merge(Data1="y4", Data2="y3", Data3="h1", Data4="z2", Data5="w1")

# ---- group: Preview / Preview nuova
lines = Merge(Data1=wires, Data2=wires_2)
surfaces = Merge(Data1=extr, Data2=extr_2)
swatch_3 = ColourSwatch(SwatchColor=RGBA(255, 0, 0, 40))
filter = StreamFilter(Gate=show_joint_srf, Stream0=lines, Stream1=surfaces)
filter_2 = StreamFilter(
    Gate=show_joint_srf,
    Stream0=ColourSwatch(SwatchColor=RGBA(0, 0, 0, 160)),
    Stream1=ColourSwatch(SwatchColor=RGBA(0, 0, 0, 70)))
filter_3 = StreamFilter(
    Gate=show_joint_srf,
    Stream0=ColourSwatch(SwatchColor=RGB(120, 120, 120)),
    Stream1=ColourSwatch(SwatchColor=RGBA(0, 0, 0, 10)))
python_8 = GhPythonScript(x=filter, y=filter_3, z=swatch_3)  # -> out, a
# ---------- python_8: Python ----------
__author__ = "davidet"
__version__ = "2021.03.03"

import rhinoscriptsyntax as rs

if x==0:
    a=y
else:
    a=z
# ---------- end python_8 ----------
preview_5 = CustomPreview(Geometry=filter, Material=python_8.a)  # disabled

# ----
python_9 = GhPythonScript(x=ma_2.Result, y=filter_2, z=swatch_3)  # -> out, a; same code as python_8
wires_3 = BrepWireframe(Brep=filter, Density=-1)

# ---- group: Cap (+) / Preview
srf_2 = Surface([boundary, boundary_11])

# ----
edges_3 = BrepEdges(Brep=srf_2)  # -> flatten(Naked), Interior, NonManifold

# ---- group: Cap (+) / Preview (continued)
preview_6 = CustomPreview(Geometry=edges_3.Naked, Material=rgb)  # disabled

# ---- group: Middle part / Preview
srf_3 = Surface([boundary_6, boundary_15, boundary_16, boundary_8])

# ----
edges_4 = BrepEdges(Brep=srf_3)  # -> flatten(Naked), Interior, NonManifold

# ---- group: Middle part / Preview (continued)
preview_7 = CustomPreview(Geometry=edges_4.Naked, Material=rgb)

# ---- group: Cap (-) / Preview
srf_4 = Surface([boundary_5, boundary_14])

# ----
edges_5 = BrepEdges(Brep=srf_4)  # -> flatten(Naked), Interior, NonManifold

# ---- group: Cap (-) / Preview (continued)
preview_8 = CustomPreview(Geometry=edges_5.Naked, Material=rgb)  # disabled

# ---- group: Contact faces (+) / Preview
srf_5 = Surface([boundary_2, boundary_12, boundary_3, boundary_13, boundary_17, boundary_4])
area_2 = Area(Geometry=srf_5)  # -> Area, Centroid
panel_96 = Panel("""1A
2A
1
2
3
4""")
tag_4 = TextTag(Location=area_2.Centroid, Text=panel_96)

# ----
edges_6 = BrepEdges(Brep=srf_5)  # -> flatten(Naked), Interior, NonManifold

# ---- group: Preview / Preview nuova (continued)
merge_14 = Merge(Data1=srf_5, Data2=srf_2, Data3=srf, Data4=srf_4, Data5=srf_3)
merge_15 = Merge(Data1=edges_6.Naked, Data2=edges_3.Naked, Data3=edges.Naked, Data4=edges_5.Naked, Data5=edges_4.Naked)
filter_4 = StreamFilter(Gate=show_joint_srf, Stream0=merge_15, Stream1=merge_14)
preview_9 = CustomPreview(Geometry=filter_4, Material=python_9.a)  # disabled

# ----
wires_4 = BrepWireframe(Brep=filter_4, Density=-1)

# ---- group: Contact faces (+) / Preview (continued)
preview_10 = CustomPreview(Geometry=edges_6.Naked, Material=rgb)  # disabled

# ---- group: Surface -x- / Project srf. A
pt_40 = ConstructPoint(XCoordinate=eval_17, YCoordinate=0, ZCoordinate=0)
panel_97 = Panel("""2
3
4
5""")
X_10 = UnitX(Factor=1)
item_55 = ListItem(List=srf_5, Index=panel_97, Wrap=True)
yz_2 = YZPlane(Origin=pt_40)
projecta_2 = ProjectAlong(Geometry=item_55, Plane=yz_2, Direction=X_10)  # -> Geometry, Transform

# ---- group: Cnt. Srf. X(+) (continued)
geo_2 = Geometry(projecta_2.Geometry)
move_43 = Move(Geometry=geo_2, Motion=X_5)  # -> Geometry, Transform
edges_7 = BrepEdges(Brep=move_43.Geometry)  # -> flatten(Naked), Interior, NonManifold

item_56 = ListItem(List=edges_7.Naked, Index=17, Wrap=True)
item_57 = ListItem(List=edges_7.Naked, Index=0, Wrap=True)
item_58 = ListItem(List=edges_7.Naked, Index=15, Wrap=True)
item_59 = ListItem(List=edges_7.Naked, Index=4, Wrap=True)
brep_2 = Brep(move_43.Geometry)
item_60 = ListItem(List=edges_7.Naked, Index=panel_76, Wrap=True)
len_2 = Length(Curve=item_56)
join_2 = JoinCurves(Curves=item_60, Preserve=False)
move_44 = Move(Geometry=item_57, Motion=Y_3)  # -> Geometry, Transform
addition_2 = Addition(A=len_2, B="8")
move_45 = Move(Geometry=item_56, Motion=Z_3)  # -> Geometry, Transform
move_46 = Move(Geometry=item_59, Motion=Z_4)  # -> Geometry, Transform
Y_8 = UnitY(Factor=expr("-x", addition_2))
move_47 = Move(Geometry=join_2, Motion=Z_5)  # -> Geometry, Transform
move_48 = Move(Geometry=item_58, Motion=Y_8)  # -> Geometry, Transform
merge_16 = Merge(Data1=move_46.Geometry, Data2=move_45.Geometry, Data3=move_47.Geometry, Data4=move_44.Geometry, Data5=move_48.Geometry)  # -> flatten(Result)
# Projected contact surfaces
entwine_9 = Entwine(Branch00=brep_2, Branch01=merge_16, Branch02=volume.Centroid, FlattenInputs=True)
filter_5 = StreamFilter(Gate=show_contact_srf, Stream1=entwine_9)
bang = ExplodeTree(Data=filter_5)  # -> Branch0, Branch1, Branch2
midpt = CurveMiddle(Curve=flatten(bang.Branch1))

# ----
point = Point(bang.Branch2)

# ---- group: Cnt. Srf. X(+) (continued)
tag_5 = TextTag(Location=flatten(midpt), Text=flatten(merge_11))
preview_11 = CustomPreview(Geometry=bang.Branch0, Material=swatch_2)
linedim = LineDimension(Line=bang.Branch1, Text="     ", Size="3")

# ---- group: Proj. Srf. D
panel_98 = Panel("""0
2
5
6
8
11
12""")
pt_41 = ConstructPoint(XCoordinate=0, YCoordinate=eval_7, ZCoordinate=0)
item_61 = ListItem(List=[srf_5, srf, srf_3], Index=panel_98, Wrap=True)
xz = XZPlane(Origin=pt_41)
Y_9 = UnitY(Factor=1)
projecta_3 = ProjectAlong(Geometry=item_61, Plane=xz, Direction=Y_9)  # -> Geometry, Transform

# ---- group: Cnt. Srf. Y (-) (continued)
geo_3 = Geometry(projecta_3.Geometry)
move_49 = Move(Geometry=geo_3, Motion=Y_4)  # -> Geometry, Transform
brep_3 = Brep(move_49.Geometry)

# ---- group: Cnt. Srf. Y (-) / y (continued)
projecta_4 = ProjectAlong(Geometry=pline_25, Plane=xz, Direction=Y_5)  # -> Geometry, Transform
move_50 = Move(Geometry=projecta_4.Geometry, Motion=Y_4)  # -> Geometry, Transform
move_51 = Move(Geometry=flatten(move_50.Geometry), Motion=multiplication_4)  # -> Geometry, Transform
midpt_2 = CurveMiddle(Curve=move_51.Geometry)
move_52 = Move(Geometry=midpt_2, Motion=Z_7)  # -> Geometry, Transform

# ---- group: Cnt. Srf. Y (-) / z (continued)
item_62 = ListItem(List=flatten(move_50.Geometry), Index=panel_89, Wrap=True)
item_63 = ListItem(List=flatten(move_50.Geometry), Index=panel_90, Wrap=True)
len_3 = Length(Curve=item_62)
ma_3 = MassAddition(Input=len_3)  # -> Result, PartialResults
len_4 = Length(Curve=item_63)
ma_4 = MassAddition(Input=len_4)  # -> Result, PartialResults
neg = Negative(Value=ma_4.Result)
merge_17 = Merge(Data1="0", Data2=ma_3.Result, Data3=neg)
X_11 = UnitX(Factor=merge_17)
projecta_5 = ProjectAlong(Geometry=pline_26, Plane=xz, Direction=Y_5)  # -> Geometry, Transform
graft_3 = GraftTree(Tree=X_11, IncludeEmptyLists=True, IncludeNullItems=True)
move_53 = Move(Geometry=projecta_5.Geometry, Motion=Y_4)  # -> Geometry, Transform
move_54 = Move(Geometry=move_53.Geometry, Motion=graft_3)  # -> Geometry, Transform
move_55 = Move(Geometry=move_54.Geometry, Motion=graft_2)  # -> flatten(Geometry), Transform
midpt_3 = CurveMiddle(Curve=move_55.Geometry)
move_56 = Move(Geometry=midpt_3, Motion=multiplication_6)  # -> Geometry, Transform

# ---- group: Cnt. Srf. Y (-)
entwine_10 = Entwine(
    Branch00=brep_3,
    Branch01=[move_51.Geometry, move_55.Geometry],
    Branch02=[move_52.Geometry, move_56.Geometry],
    FlattenInputs=True)
filter_6 = StreamFilter(Gate=show_contact_srf, Stream1=entwine_10)
bang_2 = ExplodeTree(Data=filter_6)  # -> Branch0, Branch1, Branch2
swatch_4 = ColourSwatch(SwatchColor=RGB(144, 0, 45))
preview_12 = CustomPreview(Geometry=bang_2.Branch0, Material=swatch_2)  # disabled
linedim_2 = LineDimension(Line=bang_2.Branch1, Size="2.5")
tag_6 = TextTag(Location=bang_2.Branch2, Text=[entwine_5, entwine_8])

# ---- group: Proj. Srf. C
pt_42 = ConstructPoint(XCoordinate=0, YCoordinate=eval_19, ZCoordinate=0)
panel_99 = Panel("""1
3
4
7
9
10
13""")
item_64 = ListItem(List=[srf_5, srf, srf_3], Index=panel_99, Wrap=True)
xz_2 = XZPlane(Origin=pt_42)
Y_10 = UnitY(Factor=1)
projecta_6 = ProjectAlong(Geometry=item_64, Plane=xz_2, Direction=Y_10)  # -> Geometry, Transform

# ---- group: Cnt. Srf. Y (+) (continued)
geo_4 = Geometry(projecta_6.Geometry)
move_57 = Move(Geometry=geo_4, Motion=Y)  # -> Geometry, Transform
brep_4 = Brep(move_57.Geometry)

# ---- group: Cnt. Srf. Y (+) / y (continued)
projecta_7 = ProjectAlong(Geometry=pline_23, Plane=xz_2, Direction=Y_2)  # -> Geometry, Transform
move_58 = Move(Geometry=projecta_7.Geometry, Motion=Y)  # -> Geometry, Transform
move_59 = Move(Geometry=flatten(move_58.Geometry), Motion=multiplication)  # -> Geometry, Transform
midpt_4 = CurveMiddle(Curve=move_59.Geometry)
move_60 = Move(Geometry=midpt_4, Motion=Z_2)  # -> Geometry, Transform

# ---- group: Cnt. Srf. Y (+) / z (continued)
item_65 = ListItem(List=flatten(move_58.Geometry), Index=panel_70, Wrap=True)
item_66 = ListItem(List=flatten(move_58.Geometry), Index=panel_71, Wrap=True)
len_5 = Length(Curve=item_65)
ma_5 = MassAddition(Input=len_5)  # -> Result, PartialResults
len_6 = Length(Curve=item_66)
ma_6 = MassAddition(Input=len_6)  # -> Result, PartialResults
neg_2 = Negative(Value=ma_6.Result)
merge_18 = Merge(Data1="0", Data2=ma_5.Result, Data3=neg_2)
X_12 = UnitX(Factor=merge_18)
projecta_8 = ProjectAlong(Geometry=pline_24, Plane=xz_2, Direction=Y_2)  # -> Geometry, Transform
graft_4 = GraftTree(Tree=X_12, IncludeEmptyLists=True, IncludeNullItems=True)
move_61 = Move(Geometry=projecta_8.Geometry, Motion=Y)  # -> Geometry, Transform
move_62 = Move(Geometry=move_61.Geometry, Motion=graft_4)  # -> Geometry, Transform
move_63 = Move(Geometry=move_62.Geometry, Motion=graft)  # -> flatten(Geometry), Transform
midpt_5 = CurveMiddle(Curve=move_63.Geometry)
move_64 = Move(Geometry=midpt_5, Motion=multiplication_3)  # -> Geometry, Transform

# ---- group: Cnt. Srf. Y (+) (continued)
entwine_11 = Entwine(
    Branch00=brep_4,
    Branch01=[move_59.Geometry, move_63.Geometry],
    Branch02=[move_60.Geometry, move_64.Geometry],
    FlattenInputs=True)
filter_7 = StreamFilter(Gate=show_contact_srf, Stream1=entwine_11)
bang_3 = ExplodeTree(Data=filter_7)  # -> Branch0, Branch1, Branch2
preview_13 = CustomPreview(Geometry=bang_3.Branch0, Material=swatch_2)  # disabled
linedim_3 = LineDimension(Line=bang_3.Branch1, Size="2.5")
tag_7 = TextTag(Location=bang_3.Branch2, Text=[entwine, entwine_4])

# ---- group: Cnt. Srf. X(-)
volume_2 = Volume(Geometry=cap_2)  # -> Volume, Centroid
swatch_5 = ColourSwatch(SwatchColor=RGB(144, 0, 45))
panel_100 = Panel("(-)")

entwine_12 = Entwine(Branch00=brep, Branch01=merge_12, Branch02=volume_2.Centroid, FlattenInputs=True)
filter_8 = StreamFilter(Gate=show_contact_srf, Stream1=entwine_12)
bang_4 = ExplodeTree(Data=filter_8)  # -> Branch0, Branch1, Branch2
midpt_6 = CurveMiddle(Curve=flatten(bang_4.Branch1))

# ----
point_2 = Point(bang_4.Branch2)

# ---- group: Cnt. Srf. X(-) (continued)
preview_14 = CustomPreview(Geometry=bang_4.Branch0, Material=swatch_2)
tag_8 = TextTag(Location=flatten(midpt_6), Text=flatten(merge_13))
linedim_4 = LineDimension(Line=bang_4.Branch1, Size="3")
