# Grasshopper definition strength_evaluation.gh (Grasshopper 1.0.7)

brep = Surface(<surface referenced from the Rhino model>)
brep_2 = Surface(<surface referenced from the Rhino model>)

# ----
# Test Case 1
panel = Panel("2,0,0")
panel_2 = Panel("1.3")
panel_3 = Panel("1")
pt = Point([panel, "3,0,0", "3,2,0", "2,2,0"])
pt_2 = Point(["-2,0,0", "1,0,0", "1, 1, 0", "-2, 1, 0"])
pline = PolyLine(Vertices=pt, Closed=True)
pline_2 = PolyLine(Vertices=pt_2, Closed=True)
contact_neg = Curve(pline_2)
contact_pos = Curve(pline)

# ----
# Test Case 2
crv = Curve(brep_2)
crv_2 = Curve(brep)
panel_4 = Panel("""1
1
1""")
panel_5 = Panel("""1
1
1""")

reset_modules = GhPythonScript(reset=Button())
# ---------- reset_modules: Python ----------
__author__ = "ziqwang"

import os
import sys
from compas_rhino.utilities.misc import get_tolerance
from compas_rhino.utilities.misc import unload_modules
if reload:
    #print "reloading..."
    unload_modules('compas')
    unload_modules("gkr_timber")
# ---------- end reset_modules ----------
strength_evaluation_3d = GhPythonScript(
    contact_pos=crv,
    contact_neg=crv_2,
    strength_positive=panel_4,
    strength_negative=panel_5,
    Fx="50",
    My="50",
    Mz="100",
    sample_width="1")  # -> force_pos, force_neg, bend_y_pos, bend_y_neg, bend_z_pos, bend_z_neg, stable; inputs contact_pos: list of Curve, contact_neg: list of Curve, strength_positive: list, strength_negative: list
# ---------- strength_evaluation_3d: Python ----------
__author__ = "ziqwang"

import ghpythonlib.components as gh
import rhinoscriptsyntax as rs
from compas.rpc import Proxy
strength_evaluation_3D = Proxy('gkr_timber.plasticity.strength_evaluation_3D')

# Input
# contact positive
polygons_positive = []
offset_positive = 0
for kd in range(0, len(contact_pos)):
    contact_pos_pts = gh.Discontinuity(contact_pos[kd], 1)[0]
    pts = []
    for id in range(0, len(contact_pos_pts)):
        pts.append([contact_pos_pts[id][1], contact_pos_pts[id][2]])
        offset_positive = contact_pos_pts[id][0]
    print(pts)
    polygons_positive.append(pts)

# contact negative
polygons_negative = []
offset_negative = 0
for kd in range(0, len(contact_neg)):
    contact_neg_pts = gh.Discontinuity(contact_neg[kd], 1)[0]
    pts = []
    for id in range(0, len(contact_neg_pts)):
        pts.append([contact_neg_pts[id][1], contact_neg_pts[id][2]])
        offset_negative = contact_neg_pts[id][0]
    print(pts)
    polygons_negative.append(pts)

# Parameters
minimum_segment_width = sample_width



# Evaluation
result = strength_evaluation_3D.evaluate_joint_strength_3D([polygons_positive, polygons_negative],
                                                        [strength_positive, strength_negative], 
                                                        Fx, 
                                                        My,
                                                        Mz, 
                                                        minimum_segment_width)

force_pos = []
force_neg = []
bend_y_pos = []
bend_y_neg = []
bend_z_pos = []
bend_z_neg = []

if result["stable"] == False:
    stable = False
    
else:
    stable = True
    
    # Get partition result
    partition_result = strength_evaluation_3D.extract_geometry_from_evlaution_3D_result(result)
    for poly_index in range(0, 3):
        for side_index in range(0, 2):
            polygons = partition_result[poly_index][side_index]
            for id in range(0, len(polygons)):
                poly = polygons[id]
                pts = []
                for pt in poly:
                    if side_index == 0:
                        pts.append(gh.ConstructPoint(offset_positive, pt[0], pt[1]))
                    else:
                        pts.append(gh.ConstructPoint(offset_negative, pt[0], pt[1]))
                polyline = gh.PolyLine(pts, True)
                if poly_index == 0 and side_index == 0:
                    force_pos.append(polyline)
                elif poly_index == 0 and side_index == 1:
                    force_neg.append(polyline)
                elif poly_index == 1 and side_index == 0:
                    bend_y_pos.append(polyline)
                elif poly_index == 1 and side_index == 1:
                    bend_y_neg.append(polyline)
                elif poly_index == 2 and side_index == 0:
                    bend_z_pos.append(polyline)
                elif poly_index == 2 and side_index == 1:
                    bend_z_neg.append(polyline)
# ---------- end strength_evaluation_3d ----------
panel_6 = Panel(strength_evaluation_3d.stable)  # disabled
crv_3 = Curve(strength_evaluation_3d.force_pos)
crv_4 = Curve(strength_evaluation_3d.force_neg)
crv_5 = Curve(strength_evaluation_3d.bend_y_pos)
crv_6 = Curve(strength_evaluation_3d.bend_y_neg)
crv_7 = Curve(strength_evaluation_3d.bend_z_pos)
crv_8 = Curve(strength_evaluation_3d.bend_z_neg)
area = Area(Geometry=crv_4)  # -> Area, Centroid
area_2 = Area(Geometry=crv_3)  # -> Area, Centroid
area_3 = Area(Geometry=crv_7)  # -> Area, Centroid
area_4 = Area(Geometry=crv_5)  # -> Area, Centroid
area_5 = Area(Geometry=crv_6)  # -> Area, Centroid
area_6 = Area(Geometry=crv_8)  # -> Area, Centroid
area_7 = GhPythonScript(x=area_2.Area)  # -> out, a; inputs x: list
# ---------- area_7: Python ----------
__author__ = "ziqwang"

import rhinoscriptsyntax as rs

a = sum(x)
# ---------- end area_7 ----------
area_8 = GhPythonScript(x=area.Area)  # -> out, a; inputs x: list; same code as area_7
torque = GhPythonScript(x=area_4.Area, y=area_4.Centroid)  # -> out, a; inputs x: list, y: list of Point3d
# ---------- torque: Python ----------
__author__ = "ziqwang"

import rhinoscriptsyntax as rs

a = 0
for id in range(0, len(x)):
    a += x[id] * y[id][2]
# ---------- end torque ----------
torque_2 = GhPythonScript(x=area_5.Area, y=area_5.Centroid)  # -> out, a; inputs x: list, y: list of Point3d; same code as torque
torque_3 = GhPythonScript(x=area_3.Area, y=area_3.Centroid)  # -> out, a; inputs x: list, y: list of Point3d
# ---------- torque_3: Python ----------
__author__ = "ziqwang"

import rhinoscriptsyntax as rs

a = 0
for id in range(0, len(x)):
    a += x[id] * -y[id][1]
# ---------- end torque_3 ----------
torque_4 = GhPythonScript(x=area_6.Area, y=area_6.Centroid)  # -> out, a; inputs x: list, y: list of Point3d; same code as torque_3
subtraction = Subtraction(A=torque.a, B=torque_2.a)
subtraction_2 = Subtraction(A=area_7.a, B=area_8.a)
subtraction_3 = Subtraction(A=torque_3.a, B=torque_4.a)
panel_7 = Panel(subtraction_2)
panel_8 = Panel(subtraction)
panel_9 = Panel(subtraction_3)

strength_evaluation_2d = GhPythonScript(
    contact_pos=crv,
    contact_neg=crv_2,
    strength_positive=panel_4,
    strength_negative=panel_5,
    Fx=Slider(30, range=-100..100),
    Mz="50",
    sample_width="0.1")  # -> force_pos, force_neg, bend_pos, bend_neg, stable; inputs contact_pos: list of Curve, contact_neg: list of Curve, strength_positive: list, strength_negative: list
# ---------- strength_evaluation_2d: Python ----------
__author__ = "ziqwang"

import ghpythonlib.components as gh
import rhinoscriptsyntax as rs
from compas.rpc import Proxy
strength_evaluation_2D = Proxy('gkr_timber.plasticity.strength_evaluation_2D')

# Input
# contact positive
polygons_positive = []
offset_positive = 0
for kd in range(0, len(contact_pos)):
    contact_pos_pts = gh.Discontinuity(contact_pos[kd], 1)[0]
    pts = []
    for id in range(0, len(contact_pos_pts)):
        pts.append([contact_pos_pts[id][1], contact_pos_pts[id][2]])
        offset_positive = contact_pos_pts[id][0]
    polygons_positive.append(pts)

# contact negative
polygons_negative = []
offset_negative = 0
for kd in range(0, len(contact_neg)):
    contact_neg_pts = gh.Discontinuity(contact_neg[kd], 1)[0]
    pts = []
    for id in range(0, len(contact_neg_pts)):
        pts.append([contact_neg_pts[id][1], contact_neg_pts[id][2]])
        offset_negative = contact_neg_pts[id][0]
    polygons_negative.append(pts)

# Parameters
minimum_segment_width = sample_width



# Evaluation
result = strength_evaluation_2D.evaluate_joint_strength_2D([polygons_positive, polygons_negative],
                                                        [strength_positive, strength_negative], 
                                                        Fx, 
                                                        Mz, 
                                                        minimum_segment_width)

force_pos = []
force_neg = []
bend_pos = []
bend_neg = []

if result["stable"] == False:
    stable = False
    
else:
    stable = True
    
    # Get partition result
    partition_result = strength_evaluation_2D.extract_geometry_from_evlaution_2D_result(result)
    for poly_index in range(0, 2):
        for side_index in range(0, 2):
            polygons = partition_result[poly_index][side_index]
            for id in range(0, len(polygons)):
                poly = polygons[id]
                pts = []
                for pt in poly:
                    if side_index == 0:
                        pts.append(gh.ConstructPoint(offset_positive, pt[0], pt[1]))
                    else:
                        pts.append(gh.ConstructPoint(offset_negative, pt[0], pt[1]))
                polyline = gh.PolyLine(pts, True)
                if poly_index == 0 and side_index == 0:
                    force_pos.append(polyline)
                elif poly_index == 0 and side_index == 1:
                    force_neg.append(polyline)
                elif poly_index == 1 and side_index == 0:
                    bend_pos.append(polyline)
                elif poly_index == 1 and side_index == 1:
                    bend_neg.append(polyline)
# ---------- end strength_evaluation_2d ----------
panel_10 = Panel(strength_evaluation_2d.stable)
crv_9 = Curve(strength_evaluation_2d.force_pos)
crv_10 = Curve(strength_evaluation_2d.bend_pos)
crv_11 = Curve(strength_evaluation_2d.bend_neg)
crv_12 = Curve(strength_evaluation_2d.force_neg)
area_9 = Area(Geometry=crv_10)  # -> Area, Centroid
area_10 = Area(Geometry=crv_11)  # -> Area, Centroid
area_11 = Area(Geometry=crv_12)  # -> Area, Centroid
area_12 = GhPythonScript(x=area_11.Area)  # -> out, a; inputs x: list; same code as area_7
torque_5 = GhPythonScript(x=area_9.Area, y=area_9.Centroid)  # -> out, a; inputs x: list, y: list of Point3d
# ---------- torque_5: Python ----------
__author__ = "ziqwang"

import rhinoscriptsyntax as rs

a = 0
for id in range(0, len(x)):
    a += -x[id] * y[id][1]
# ---------- end torque_5 ----------
torque_6 = GhPythonScript(x=area_10.Area, y=area_10.Centroid)  # -> out, a; inputs x: list, y: list of Point3d; same code as torque_5
area_13 = GhPythonScript(x=area_10.Area)  # -> out, a; inputs x: list; same code as area_7
area_14 = GhPythonScript(x=area_9.Area)  # -> out, a; inputs x: list; same code as area_7
subtraction_4 = Subtraction(A=torque_5.a, B=torque_6.a)
subtraction_5 = Subtraction(A=area_14.a, B=area_13.a)
panel_11 = Panel(subtraction_4)
panel_12 = Panel(subtraction_5)

area_15 = Area(Geometry=crv_9)  # -> Area, Centroid
area_16 = GhPythonScript(x=area_15.Area)  # -> out, a; inputs x: list; same code as area_7
subtraction_6 = Subtraction(A=area_16.a, B=area_12.a)

panel_13 = Panel(subtraction_6)
