# Grasshopper definition test.gh (Grasshopper 1.0.7)

# ----
# Test Case 1
panel = Panel("2,0,0")
panel_2 = Panel("1.3")
panel_3 = Panel("1")
pt = Point([panel, "3,0,0", "3,2,0", "2,2,0"])
pt_2 = Point(["-2,0,0", "1,0,0", "1, 1, 0", "-2, 1, 0"])
pline = PolyLine(Vertices=pt, Closed=True)
pline_2 = PolyLine(Vertices=pt_2, Closed=True)
contact_neg = Curve(pline_2)
contact_pos = Curve(pline)

# ----
# Test Case 2
crv = Curve([<curve referenced from the Rhino model> x3])
crv_2 = Curve([<curve referenced from the Rhino model> x3])
panel_4 = Panel("""1
1
1""")
panel_5 = Panel("""1
1
1""")
disc = Discontinuity(Curve=crv, Level=1)  # -> Points, Parameters

python = GhPythonScript(
    contact_pos=crv,
    contact_neg=crv_2,
    strength_positive=panel_4,
    strength_negative=panel_5,
    Fx="-10",
    Mz="200",
    sample_width="0.1")  # -> out, force_pos, force_neg, bend_pos, bend_neg, stable; inputs contact_pos: list of Curve, contact_neg: list of Curve, strength_positive: list, strength_negative: list
# ---------- python: Python ----------
__author__ = "ziqwang"

import ghpythonlib.components as gh
import rhinoscriptsyntax as rs
from compas.rpc import Proxy
strength_evaluation = Proxy('gkr_timber.plasticity.strength_evaluation')

# Input
# contact positive
polygons_positive = []
for kd in range(0, len(contact_pos)):
    contact_pos_pts = gh.Discontinuity(contact_pos[kd], 1)[0]
    pts = []
    for id in range(0, len(contact_pos_pts)):
        pts.append([contact_pos_pts[id][0], contact_pos_pts[id][1]])
    polygons_positive.append(pts)

# contact negative
polygons_negative = []
for kd in range(0, len(contact_neg)):
    contact_neg_pts = gh.Discontinuity(contact_neg[kd], 1)[0]
    pts = []
    for id in range(0, len(contact_neg_pts)):
        pts.append([contact_neg_pts[id][0], contact_neg_pts[id][1]])
    polygons_negative.append(pts)

# Parameters
minimum_segment_width = sample_width

# Evaluation
result = strength_evaluation.evaluate_joint_strength_2D(polygons_positive,
                                                        strength_positive, 
                                                        polygons_negative, 
                                                        strength_negative, 
                                                        Fx, 
                                                        Mz, 
                                                        minimum_segment_width)
                                                        
# Exam Result
force_pos = []
force_neg = []
bend_pos = []
bend_neg = []

if result["stable"] == False:
    stable = False
    
else:
    stable = True
    
    # Get partition result
    partition_result = strength_evaluation.get_partition_result([polygons_positive, polygons_negative],
                                                            result["slice_region"],
                                                            result["segment_data"],
                                                            result["height_force"],
                                                            result["height_bending"])

    polys_force = partition_result["polys_force"]
    polys_bending = partition_result["polys_bending"]

    #force
    for side_index in range(0, 2):
        poly = polys_force[side_index]
        for id in range(0, len(poly)):
            pts = []
            for jd in range(0, len(poly[id])):
                pts.append(gh.ConstructPoint(poly[id][jd][0], poly[id][jd][1], 0))
            curve = gh.PolyLine(pts, True)
            if side_index == 0:
                force_pos.append(curve)
            else:
                force_neg.append(curve)
            
    #bending

    for side_index in range(0, 2):
        poly = polys_bending[side_index]
        for id in range(0, len(poly)):
            pts = []
            for jd in range(0, len(poly[id])):
                pts.append(gh.ConstructPoint(poly[id][jd][0], poly[id][jd][1], 0))
            curve = gh.PolyLine(pts, True)
            if side_index == 0:
                bend_pos.append(curve)
            else:
                bend_neg.append(curve)
# ---------- end python ----------
panel_6 = Panel(python.stable)
crv_3 = Curve(python.force_pos)
crv_4 = Curve(python.bend_pos)
crv_5 = Curve(python.bend_neg)
crv_6 = Curve(python.force_neg)
